# Grasshopper definition diagram_sqaure_CNC.gh (Grasshopper 1.0.7)
# plug-ins: Human

# ---- group: Body
squarelength = Slider(11.12, range=0..300)
W = Slider(1.75, range=0..35)
thk = Slider(0.25, range=0..15)

# ---- group: Joinery
end_notch = Slider(0, range=0..10)
vertical_l_thk = Slider(0.48, range=0..10)
horizontal_l_thk = Slider(0.27, range=0..10)

# ---- group: Joinery / b
multiplication = Multiplication(A=vertical_l_thk, B=2)
subtraction = Subtraction(A=W, B=multiplication)
panel = Panel(subtraction)

# ---- group: Base Square
pt = ConstructPoint(XCoordinate=0, YCoordinate=300, ZCoordinate=0)
X = UnitX(Factor=1)
Y = UnitY(Factor=1)
line = LineSDL(Start=pt, Direction=X, Length=squarelength)
line_2 = LineSDL(Start=pt, Direction=Y, Length=squarelength)
swp1 = Sweep1(Rail=line_2, Sections=line, Miter=1)

# ----
concat = Concatenate(FragmentA="Thickness: ", FragmentB=thk)
panel_2 = Panel(concat)
texttoscreen = RenderTextToScreen(Text=panel_2, Location=pt, Size="10", Color=RGB(0, 0, 0), m_scWithvp=False)

# ---- group: Base Joinery1
multiplication_2 = Multiplication(A=horizontal_l_thk, B=2)
addition = Addition(A=multiplication_2, B=thk)
neg = Negative(Value=addition)

# ---- group: CycleLength in X direction
addition_2 = Addition(A=squarelength, B=addition)
panel_3 = Panel(addition_2)

# ----
division = Division(A=thk, B=2)
multiplication_3 = Multiplication(A=panel_3, B=2)
Z = UnitZ(Factor=multiplication_3)
neg_2 = Negative(Value=Z)

# ---- group: Body
panel_4 = Panel("""1
3""")
panel_5 = Panel("""0
2""")
debrep = DeconstructBrep(Brep=swp1)  # -> Faces, Edges, Vertices
division_2 = Division(A=squarelength, B=2)
division_3 = Division(A=W, B=2)
item = ListItem(List=debrep.Edges, Index=panel_5, Wrap=True)
subtraction_2 = Subtraction(A=division_2, B=division_3)
item_2 = ListItem(List=debrep.Edges, Index=panel_4, Wrap=True)
division_4 = Division(A=subtraction_2, B=squarelength)
division_5 = Division(A=W, B=squarelength)
end = EndPoints(Curve=item)  # -> Start, End
eval = EvaluateLength(Curve=item_2, Length=division_4, Normalized=True)  # -> Point, Tangent, Parameter
eval_2 = EvaluateLength(Curve=item, Length=division_5, Normalized=True)  # -> Point, Tangent, Parameter
end_2 = EndPoints(Curve=item_2)  # -> Start, End
vec2pt = Vector2Pt(PointA=end.End, PointB=eval.Point, Unitize=False)  # -> Vector, Length
vec2pt_2 = Vector2Pt(PointA=end_2.Start, PointB=eval_2.Point, Unitize=False)  # -> Vector, Length
move = Move(Geometry=item, Motion=vec2pt.Vector)  # -> Geometry, Transform
move_2 = Move(Geometry=item_2, Motion=vec2pt_2.Vector)  # -> Geometry, Transform
eval_3 = EvaluateLength(Curve=move_2.Geometry, Length=division_4, Normalized=True)  # -> Point, Tangent, Parameter
merge = Merge(Data1=graft(eval_2.Point), Data2=graft(eval_3.Point), Data3=graft(eval.Point))  # -> simplify(Result)

pt_2 = Point(end_2.End)
rev = ReverseList(List=pt_2)

ln = Line(StartPoint=eval_3.Point, EndPoint=eval.Point)
ln_2 = Line(StartPoint=eval_2.Point, EndPoint=eval_3.Point)
ln_3 = Line(StartPoint=eval_2.Point, EndPoint=rev)
ln_4 = Line(StartPoint=eval.Point, EndPoint=pt_2)

# ---- group: Base Joinery1
line_3 = Line(ln_3)
item_3 = ListItem(List=line_3, Index=1, Wrap=True)
item_4 = ListItem(List=line_3, Index=0, Wrap=True)
flip = FlipCurve(Curve=item_3)  # -> Curve, Flag
addition_3 = Addition(A=vertical_l_thk, B=panel)
end_3 = EndPoints(Curve=item_3)  # -> Start, End
end_4 = EndPoints(Curve=item_4)  # -> Start, End
division_6 = Division(A=vertical_l_thk, B=W)
division_7 = Division(A=addition_3, B=W)
eval_4 = EvaluateLength(Curve=[flip.Curve, item_4], Length=division_6, Normalized=True)  # -> Point, Tangent, Parameter
merge_2 = Merge(Data1=end_3.End, Data2=end_4.Start)
eval_5 = EvaluateLength(Curve=[flip.Curve, item_4], Length=division_7, Normalized=True)  # -> Point, Tangent, Parameter
ln_5 = Line(StartPoint=eval_4.Point, EndPoint=merge_2)  # disabled
ln_6 = Line(StartPoint=eval_5.Point, EndPoint=merge_2)
X_2 = UnitX(Factor=addition)
X_3 = UnitX(Factor=neg)
merge_3 = Merge(Data1=X_2, Data2=X_3)
extr = Extrude(Base=ln_6, Direction=merge_3)

# ---- group: Base Joinery2
line_4 = Line(ln_4)
flip_2 = FlipCurve(Curve=line_4)  # -> Curve, Flag
addition_4 = Addition(A=panel, B=vertical_l_thk)
len = Length(Curve=line_4)
addition_5 = Addition(A=addition_4, B=vertical_l_thk)
addition_6 = Addition(A=addition_5, B=end_notch)
division_8 = Division(A=vertical_l_thk, B=len)
division_9 = Division(A=addition_5, B=len)
vec = Vector(line_3)
division_10 = Division(A=addition_4, B=len)
division_11 = Division(A=addition_6, B=len)
unit = UnitVector(Vector=vec)
division_12 = Division(A=thk, B=2)
eval_6 = EvaluateLength(Curve=flip_2.Curve, Length=division_8, Normalized=True)  # -> graft(Point), Tangent, Parameter
eval_7 = EvaluateLength(Curve=flip_2.Curve, Length=division_10, Normalized=True)  # -> graft(Point), Tangent, Parameter
eval_8 = EvaluateLength(Curve=flip_2.Curve, Length=division_9, Normalized=True)  # -> graft(Point), Tangent, Parameter
eval_9 = EvaluateLength(Curve=flip_2.Curve, Length=division_11, Normalized=True)  # -> graft(Point), Tangent, Parameter
rev_2 = ReverseList(List=unit)
multiplication_4 = Multiplication(A=division_12, B=rev_2)  # -> graft(Result)
end_5 = EndPoints(Curve=line_4)  # -> Start, graft(End)
move_3 = Move(Geometry=eval_6.Point, Motion=multiplication_4)  # -> Geometry, Transform
move_4 = Move(Geometry=eval_7.Point, Motion=multiplication_4)  # -> Geometry, Transform
move_5 = Move(Geometry=eval_8.Point, Motion=multiplication_4)  # -> Geometry, Transform
move_6 = Move(Geometry=eval_9.Point, Motion=multiplication_4)  # -> Geometry, Transform
merge_4 = Merge(
    Data1=end_5.End,
    Data2=eval_6.Point,
    Data3=move_3.Geometry,
    Data4=move_4.Geometry,
    Data5=eval_7.Point,
    Data6=eval_8.Point,
    Data7=move_5.Geometry,
    Data8=move_6.Geometry,
    Data9=eval_9.Point)
vec_2 = Vector(line_3)
division_13 = Division(A=addition, B=2)
unit_2 = UnitVector(Vector=vec_2)
subtraction_3 = Subtraction(A=division_13, B=division_12)
rev_3 = ReverseList(List=unit_2)
multiplication_5 = Multiplication(A=subtraction_3, B=rev_3)  # -> graft(Result)
move_7 = Move(Geometry=merge_4, Motion=multiplication_5)  # -> simplify(Geometry), Transform

# ---- group: Body (continued)
boundary = BoundarySurfaces(Edges=[ln_3, ln_4, ln_2, ln])

# ---- group: Joinery1
vec2pt_3 = Vector2Pt(PointA=merge_2, PointB=eval_4.Point, Unitize=False)  # -> Vector, Length
debrep_2 = DeconstructBrep(Brep=extr)  # -> Faces, Edges, Vertices
addition_7 = Addition(A=thk, B=horizontal_l_thk)
item_5 = ListItem(List=debrep_2.Edges, Index=2, Wrap=True)
item_6 = ListItem(List=debrep_2.Edges, Index=0, Wrap=True)
division_14 = Division(A=horizontal_l_thk, B=addition)
division_15 = Division(A=addition_7, B=addition)
move_8 = Move(Geometry=item_5, Motion=vec2pt_3.Vector)  # -> Geometry, Transform
eval_10 = EvaluateLength(Curve=move_8.Geometry, Length=division_14, Normalized=True)  # -> Point, Tangent, Parameter
eval_11 = EvaluateLength(Curve=item_6, Length=division_15, Normalized=True)  # -> Point, Tangent, Parameter
item_7 = ListItem(List=debrep_2.Vertices, Index=2, Wrap=True)
item_8 = ListItem(List=debrep_2.Vertices, Index=1, Wrap=True)
merge_5 = Merge(Data1=graft(eval_4.Point), Data2=eval_10.Point, Data3=eval_11.Point, Data4=item_8, Data5=item_7, Data6=graft(merge_2))  # -> simplify(Result)

# ----
branch = TreeBranch(Tree=merge, Path="{1}", MaintainPaths=True)
branch_2 = TreeBranch(Tree=merge, Path="{0}", MaintainPaths=True)
simplify = SimplifyTree(Tree=eval_9.Point, Front=False)
rev_4 = ReverseList(List=branch)
rev_5 = ReverseList(List=branch_2)
branch_3 = TreeBranch(Tree=[move_7.Geometry, simplify], Path="{1}", MaintainPaths=True)
branch_4 = TreeBranch(Tree=[move_7.Geometry, simplify], Path="{0}", MaintainPaths=True)
branch_5 = TreeBranch(Tree=merge_5, Path="{1}", MaintainPaths=True)
branch_6 = TreeBranch(Tree=merge_5, Path="{0}", MaintainPaths=True)
merge_6 = Merge(
    Data1=flatten(rev_5),
    Data2=flatten(branch_5),
    Data3=flatten(branch_3),
    Data4=flatten(rev_4),
    Data5=flatten(branch_6),
    Data6=flatten(branch_4))

item_9 = ListItem(List=flatten(eval_10.Point), Index=2, Wrap=True)
shift = ShiftList(List=branch_3, Shift=1, Wrap=True)
crv = Curve(ln_3)
crv_cp = CurveClosestPoint(Point=eval_11.Point, Curve=crv)  # -> flatten(Point), Parameter, Distance
X_4 = UnitX(Factor=1)
ln_7 = Line(StartPoint=branch_3, EndPoint=shift)
ln_8 = Line(StartPoint=eval_4.Point, EndPoint=flatten(merge_2))
item_10 = ListItem(List=ln_3, Index=0, Wrap=True)
ln_9 = Line(StartPoint=item_8, EndPoint=eval_11.Point)
X_5 = UnitX(Factor=Slider(3, range=0..10))
item_11 = ListItem(List=flatten(end_5.End), Index=1, Wrap=True)
line_5 = LineSDL(Start=item_9, Direction=X_4, Length=thk)
item_12 = ListItem(List=eval_4.Point, Index=1, Wrap=True)
item_13 = ListItem(List=crv_cp.Point, Index=2, Wrap=True)
panel_6 = Panel("""0
2
4
5
6
8""")
move_9 = Move(Geometry=item_10, Motion=X_5)  # -> Geometry, Transform
Y_2 = UnitY(Factor=vertical_l_thk)
end_6 = EndPoints(Curve=line_5)  # -> Start, End
item_14 = ListItem(List=ln_7, Index=panel_6, Wrap=True)
Y_3 = UnitY(Factor=Slider(12, range=0..100))
X_6 = UnitX(Factor=Slider(15, range=0..100))
flip_3 = FlipCurve(Curve=move_9.Geometry)  # -> Curve, Flag
ln_10 = Line(StartPoint=item_12, EndPoint=flatten(item_13))
ln_11 = Line(StartPoint=item_13, EndPoint=item_11)
neg_3 = Negative(Value=Y_2)
move_10 = Move(Geometry=line_2, Motion=X_6)  # -> Geometry, Transform
move_11 = Move(Geometry=line, Motion=Y_3)  # -> Geometry, Transform
flip_4 = FlipCurve(Curve=ln_10)  # -> Curve, Flag
flip_5 = FlipCurve(Curve=ln_11)  # -> Curve, Flag
line_6 = LineSDL(Start=end_6.End, Direction=X_4, Length=horizontal_l_thk)
move_12 = Move(Geometry=line_6, Motion=neg_3)  # -> Geometry, Transform
linedim = LineDimension(
    Line=[ln_9, move_11.Geometry, move_10.Geometry, ln_8, item_14, flip_3.Curve, flip_4.Curve, flip_5.Curve, line_5, move_12.Geometry],
    Text="{0:0.00}",
    Size=Slider(0.562, range=0..10))

shift_2 = ShiftList(List=merge_6, Shift=1, Wrap=True)
ln_12 = Line(StartPoint=merge_6, EndPoint=shift_2)
boundary_2 = BoundarySurfaces(Edges=ln_12)

# ---- group: 0
Z_2 = UnitZ(Factor=thk)
extr_2 = Extrude(Base=boundary_2, Direction=Z_2)

# ----
X_7 = UnitX(Factor=Slider(500, range=0..1000))
move_13 = Move(Geometry=extr_2, Motion=X_7)  # -> Geometry, Transform

# ---- group: 1
# XY plane
item_15 = ListItem(List=branch_4, Index=2, Wrap=True)
xz = XZPlane(Origin=item_15)
mirror = Mirror(Geometry=extr_2, Plane=xz)  # -> Geometry, Transform

# ---- group: 0-A
item_16 = ListItem(List=flatten(item_7), Index=0, Wrap=True)
yz = YZPlane(Origin=item_16)
mirror_2 = Mirror(Geometry=extr_2, Plane=yz)  # -> Geometry, Transform
area = Area(Geometry=swp1)  # -> Area, Centroid
xy = XYPlane(Origin=area.Centroid)
rotate = Rotate(Geometry=mirror_2.Geometry, Angle=3.141592654, Plane=xy)  # -> Geometry, Transform
X_8 = UnitX(Factor=addition)
move_14 = Move(Geometry=rotate.Geometry, Motion=X_8)  # -> Geometry, Transform

# ---- group: 1-A
xz_2 = XZPlane(Origin=item_15)
mirror_3 = Mirror(Geometry=move_14.Geometry, Plane=xz_2)  # -> Geometry, Transform

# ---- group: 0-B
multiplication_6 = Multiplication(A=panel_3, B=2)
X_9 = UnitX(Factor=multiplication_6)
move_15 = Move(Geometry=move_14.Geometry, Motion=X_9)  # -> Geometry, Transform

# ---- group: 1-B
xz_3 = XZPlane(Origin=item_15)
mirror_4 = Mirror(Geometry=move_15.Geometry, Plane=xz_3)  # -> Geometry, Transform

# ---- group: 0-C
multiplication_7 = Multiplication(A=panel_3, B=2)
X_10 = UnitX(Factor=multiplication_7)
move_16 = Move(Geometry=extr_2, Motion=X_10)  # -> Geometry, Transform

# ---- group: 1-C
xz_4 = XZPlane(Origin=item_15)
mirror_5 = Mirror(Geometry=move_16.Geometry, Plane=xz_4)  # -> Geometry, Transform

# ---- group: Repeats
multiplication_8 = Multiplication(A=panel_3, B=2)
Y_4 = UnitY(Factor=multiplication_8)
neg_4 = Negative(Value=Y_4)
move_17 = Move(Geometry=[mirror.Geometry, mirror_3.Geometry, mirror_4.Geometry, mirror_5.Geometry], Motion=neg_4)  # -> Geometry, Transform

multiplication_9 = Multiplication(A=panel_3, B=2)
Y_5 = UnitY(Factor=multiplication_9)
move_18 = Move(Geometry=[extr_2, move_14.Geometry, move_15.Geometry, move_16.Geometry], Motion=Y_5)  # -> Geometry, Transform

# ---- group: 3 (XZ)
# XZ plane
item_17 = ListItem(List=eval.Point, Index=1, Wrap=True)
yz_2 = YZPlane(Origin=item_17)
item_18 = ListItem(List=flatten(end_5.End), Index=1, Wrap=True)
xz_5 = XZPlane(Origin=Point(0, 0, 0))
Z_3 = UnitZ(Factor=horizontal_l_thk)
neg_5 = Negative(Value=Z_3)
multiplication_10 = Multiplication(A=panel_3, B=2)
subtraction_4 = Subtraction(A=multiplication_10, B=subtraction_3)
Y_6 = UnitY(Factor=subtraction_4)

# ---- group: 2 (YZ)
# YZ plane
item_19 = ListItem(List=eval.Point, Index=1, Wrap=True)
multiplication_11 = Multiplication(A=panel_3, B=2)
yz_3 = YZPlane(Origin=item_19)
subtraction_5 = Subtraction(A=multiplication_11, B=division_13)
item_20 = ListItem(List=flatten(end_5.End), Index=1, Wrap=True)
xy_2 = XYPlane(Origin=item_20)
addition_8 = Addition(A=thk, B=horizontal_l_thk)
neg_6 = Negative(Value=addition_8)
X_11 = UnitX(Factor=neg_6)

# ----
subtraction_6 = Subtraction(A=subtraction_5, B=division)

# ---- group: 2 (YZ) (continued)
neg_7 = Negative(Value=subtraction_6)
Z_4 = UnitZ(Factor=neg_7)

# ---- group: Stack in Z direction
merge_7 = Merge(
    Data1=extr_2,
    Data2=move_14.Geometry,
    Data3=move_15.Geometry,
    Data4=move_16.Geometry,
    Data5=mirror.Geometry,
    Data6=mirror_3.Geometry,
    Data7=mirror_4.Geometry,
    Data8=mirror_5.Geometry,
    Data9=move_17.Geometry)
merge_8 = Merge(
    Data1=extr_2,
    Data2=move_14.Geometry,
    Data3=move_15.Geometry,
    Data4=move_16.Geometry,
    Data5=mirror.Geometry,
    Data6=mirror_3.Geometry,
    Data7=mirror_4.Geometry,
    Data8=mirror_5.Geometry,
    Data9=move_18.Geometry)
Y_7 = UnitY(Factor=panel_3)
Z_5 = UnitZ(Factor=panel_3)
move_19 = Move(Geometry=merge_7, Motion=Y_7)  # -> Geometry, Transform
neg_8 = Negative(Value=Z_5)
move_20 = Move(Geometry=move_19.Geometry, Motion=neg_8)  # -> Geometry, Transform
move_21 = Move(Geometry=move_19.Geometry, Motion=Z_5)  # -> Geometry, Transform

# ----
move_22 = Move(Geometry=merge_8, Motion=neg_2)  # -> Geometry, Transform; disabled

# ---- group: Stack in Z direction (continued)
merge_9 = Merge(Data1=move_20.Geometry, Data2=move_21.Geometry, Data3=merge_8, Data4=move_22.Geometry)

# ---- group: 3 (XZ) (continued)
rotate_2 = Rotate(Geometry=merge_9, Angle=1.570796327, Plane=yz_2)  # -> Geometry, Transform
rotate_3 = Rotate(Geometry=rotate_2.Geometry, Angle=-1.570796327, Plane=xz_5)  # -> Geometry, Transform
move_23 = Move(Geometry=rotate_3.Geometry, Motion=neg_5)  # -> Geometry, Transform
move_24 = Move(Geometry=move_23.Geometry, Motion=Y_6)  # -> Geometry, Transform

# ---- group: 2 (YZ) (continued)
rotate_4 = Rotate(Geometry=merge_9, Angle=1.570796327, Plane=yz_3)  # -> Geometry, Transform
rotate_5 = Rotate(Geometry=rotate_4.Geometry, Angle=1.570796327, Plane=xy_2)  # -> Geometry, Transform
move_25 = Move(Geometry=rotate_5.Geometry, Motion=Z_4)  # -> Geometry, Transform
move_26 = Move(Geometry=move_25.Geometry, Motion=X_11)  # -> Geometry, Transform
